# Grasshopper definition hextile_components.gh (Grasshopper 1.0.8)

number_slider = Slider(131, range=0..360)  # disabled
number_slider_2 = Slider(4, range=0..10)  # disabled
number_slider_3 = Slider(3.1, range=-10..10)  # disabled
number_slider_4 = Slider(7.4, range=-10..10)  # disabled
number_slider_5 = Slider(5.2, range=-10..10)  # disabled
number_slider_6 = Slider(80, range=0..360)  # disabled
pt = Point(Point(0.5134748452, 0.9227445607, 0))  # disabled
rephexagon = Python3Script(
    ptOrigin=pt,
    length1=number_slider_4,
    length2=number_slider_3,
    length3=number_slider_5,
    angle1=number_slider_6,
    angle2=number_slider)  # -> out, firstHexObj, crvFirstHex, ptsFirstHex, crvsHexEdges, ptFirstHexCentroid; inputs ptOrigin: tree of Point3d; disabled
#   port ptOrigin: Start point of Hexagonal tesselation.
# ---------- rephexagon: Python ----------
"""Grasshopper Script"""

import ghpythonlib.components as gh 
import scriptcontext as sc
import math as m 

# Draw  hexagon
def drawHexagon (centroid):
    ptsHexagon = []
    numsOrigin = gh.PointstoNumbers(centroid, "XYZ") 
    plane = gh.XYPlane(gh.NumberstoPoints([0,0,0], "XYZ"))

    # draw hexagon vertices, counterclockwise
    pt0= gh.NumberstoPoints([numsOrigin[0], numsOrigin[1],  numsOrigin[2]], "XYZ")
    ptsHexagon.append(pt0)

    vec1 = gh.VectorXYZ(length1, 0, 0).vector #start point
    pt1= gh.Move(pt0, vec1).geometry
    ptsHexagon.append(pt1)

    vec1Rev = gh.Reverse(vec1) #point 2
    vec2 = gh.UnitVector(gh.Rotate(vec1Rev, m.radians(- angle1), plane).geometry)
    pt2= gh.Move(pt1, vec2 * length2).geometry
    ptsHexagon.append(pt2)

    vec2Rev = gh.UnitVector(gh.Reverse(vec2)) #point 3
    vec3 = gh.Rotate(vec2Rev, m.radians(- angle2), plane).geometry
    pt3= gh.Move(pt2, vec3 * length3).geometry
    ptsHexagon.append(pt3)

    pt4 = gh.Move(pt3, vec1Rev).geometry #point 4
    ptsHexagon.append(pt4)

    pt5 = gh.Move(pt4, vec2Rev * length2).geometry #point 4
    ptsHexagon.append(pt5)

    # draw curves
    crvHexagon = gh.PolyLine(ptsHexagon, True)

    # explode curves into edges
    crvsHexEdges = gh.Explode(crvHexagon, False).segments

    # find centroid
    ptCentroid = gh.Average(ptsHexagon)
    
    return ptsHexagon, crvHexagon, crvsHexEdges, ptCentroid


class Hexagon:
    def __init__(self, vertices, curve, edges, centroid):
        self.curve = curve
        self.vertices = vertices
        self.edges = edges
        self.centroid = centroid

sc.sticky["repHexagon"] = Hexagon

# draw first hexagon
firstHex = drawHexagon(ptOrigin)
firstHexObj = Hexagon(firstHex[0], firstHex[1], firstHex[2], firstHex[3])

ptsFirstHex = firstHexObj.vertices
crvFirstHex = firstHexObj.curve
crvsHexEdges = firstHexObj.edges
ptFirstHexCentroid = firstHexObj.centroid
# ---------- end rephexagon ----------
pt_2 = Point([Point(4.423475929, -60.18158714, 0), Point(74.50705563, 100.6512432, 0), Point(109.5488455, 117.7228844, 0), Point(173.3428731, 44.04527497, 0)])
mohr_hex_1_ih_1 = IronPython2Script(points=pt_2)  # -> polyline, repTile; inputs points: list of Point3d
# ---------- mohr_hex_1_ih_1: IronPython ----------
"""Grasshopper Script"""
import Grasshopper
import ghpythonlib.components as gh 
class Tile:
    def __init__(self, vertices, vectors, polyline, centroid):
        self.vertices = vertices
        self.vectors = vectors
        self.polyline = polyline
        self.centroid = centroid

    def Tiling (self, num_layers):
        return None


def CreateHexagon(points):
    if not points or len(points) != 4:
        ghenv.Component.AddRuntimeMessage(
            Grasshopper.Kernel.GH_RuntimeMessageLevel.Error,
            "Expected 4 points, got {}".format(len(points) if points else 0)
        )
        return None
    
    # create edge vectors from points
    list_vectors = []
    user_vectors = []
    for i in range(len(points)):
        if i < len(points) - 1:
            vector = gh.Vector2Pt(points[i], points[i+1], False).vector
            user_vectors.append(vector)
            list_vectors.append(vector)
    
    for vector in user_vectors: # complete edge vectors from tiling rules
        list_vectors.append(vector)


    # complete shape via tiling rules
    point_4 = gh.Move(points[-1], -list_vectors[0]).geometry
    point_5 = gh.Move(point_4, -list_vectors[1]).geometry
    list_points = points
    list_points.append(point_4)
    list_points.append(point_5)

    # create tile shape
    polyline = gh.PolyLine(list_points,True)

    # find centroid
    centroid = gh.Area(polyline).centroid

    HexagonTile = Tile(list_points, list_vectors, polyline, centroid)

    return HexagonTile


# Call function
repTile = CreateHexagon(points)
polyline = repTile.polyline
# ---------- end mohr_hex_1_ih_1 ----------
ipy2 = IronPython2Script(points=pt_2)  # -> out, a; inputs points: list
# ---------- ipy2: IronPython ----------
# gh_component.py
from ghpythonlib.componentbase import executingcomponent as EC
from Grasshopper.Kernel import GH_ParamAccess
from Grasshopper.Kernel.Parameters import Param_Number
# ---------- end ipy2 ----------
crv = Curve(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)  # disabled
crv_2 = Curve(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)  # disabled
crv_3 = Curve(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)  # disabled
repcustomize = Python3Script(firstHexObj=rephexagon.firstHexObj, crvCustomEdge1=crv, crvCustomEdge2=crv_2, crvCustomEdge3=crv_2)  # -> out, objHex, test, crvsEdge_new; inputs crvCustomEdge1: Curve, crvCustomEdge2: Curve, crvCustomEdge3: Curve; disabled
# ---------- repcustomize: Python ----------
"""Grasshopper Script"""

import ghpythonlib.components as gh
import scriptcontext as sc

Hexagon = sc.sticky["repHexagon"]

def CustomEdgeOrient (oldEdge, customEdge):
    # old edge data
    numLength_old = gh.Length(oldEdge)
    ptsEnd_old = gh.EndPoints(oldEdge)
    vecEdge_old = gh.Vector2Pt(ptsEnd_old.start, ptsEnd_old.end, False).vector

    # custom edge data
    ptsEnd_custom= gh.EndPoints(customEdge)    
    numLength_custom = gh.Distance(ptsEnd_custom.start, ptsEnd_custom.end)
    vecEdge_custom = gh.Vector2Pt(ptsEnd_custom.start, ptsEnd_custom.end, False).vector

    # orient values
    vecMove = gh.Vector2Pt(ptsEnd_custom.start, ptsEnd_old.start ,False).vector
    numRotate = gh.Angle(vecEdge_custom, vecEdge_old).angle
    numScale = numLength_old / numLength_custom
    pln_old = gh.AlignPlane(gh.XYPlane(ptsEnd_old.start), vecEdge_old).plane
    pln_custom = gh.AlignPlane(gh.XYPlane(ptsEnd_custom.start), vecEdge_custom).plane

    # geometric scale and orientation of custom curve
    crvOriented = gh.Orient(customEdge, pln_custom, pln_old).geometry
    crvScaled = gh.Scale(crvOriented, ptsEnd_old.start, numScale).geometry
    
    
    return crvScaled
    

crvsEdge = firstHexObj.edges


# position new edge 1,4
crvEdge1_new = CustomEdgeOrient (crvsEdge[0], crvCustomEdge1)
crvEdge4_new = CustomEdgeOrient (gh.FlipCurve(crvsEdge[3]).curve, crvCustomEdge1)

# position new edge 2,5
crvEdge2_new = CustomEdgeOrient (crvsEdge[1], crvCustomEdge2)
crvEdge5_new = CustomEdgeOrient (gh.FlipCurve(crvsEdge[4]).curve, crvCustomEdge2)

# position new edge 3,6
crvEdge3_new = CustomEdgeOrient (crvsEdge[2], crvCustomEdge3)
crvEdge6_new = CustomEdgeOrient (gh.FlipCurve(crvsEdge[5]).curve, crvCustomEdge3)

# reorder edge list
crvsEdge_new = []
crvsEdge_new.append(crvEdge1_new)
crvsEdge_new.append(crvEdge2_new)
crvsEdge_new.append(crvEdge3_new)
crvsEdge_new.append(crvEdge4_new)
crvsEdge_new.append(crvEdge5_new)
crvsEdge_new.append(crvEdge6_new)

crvHexagon_new = gh.JoinCurves(crvsEdge_new, False)
ptCentroid_new = gh.Area(crvHexagon_new).centroid

objHex = Hexagon(firstHexObj.vertices, crvHexagon_new, crvsEdge_new, ptCentroid_new)
# ---------- end repcustomize ----------
reptile = Python3Script(objHex=repcustomize.objHex, intGridSize=number_slider_2)  # -> out, crvsHexTile; inputs intGridSize: Int32; disabled
# ---------- reptile: Python ----------
"""Grasshopper Script"""

import rhinoscriptsyntax as rs 
import ghpythonlib.components as gh 
import math as m 



# Hex tiling
ptsTileStart = []

ptsFirstHex = objHex.vertices

vecFirstMove_row = gh.Vector2Pt(ptsFirstHex[0],ptsFirstHex[2],False).vector
vecFirstMove_col = gh.Vector2Pt(ptsFirstHex[0],ptsFirstHex[4],False).vector

## grid points
ptLead = ptsFirstHex[0]
for i in range(intGridSize):
    for j in range(intGridSize):
        ptMove_row = gh.Move(ptLead, vecFirstMove_row * j).geometry
        ptsTileStart.append(ptMove_row)
    ptLead = gh.Move(ptLead, vecFirstMove_col).geometry

crvsHexTile = []
for pt in ptsTileStart:
    vecMoveTile = gh.Vector2Pt(ptsFirstHex[0], pt, False).vector
    crvHexTile = gh.Move(objHex.curve, vecMoveTile).geometry
    crvsHexTile.append(crvHexTile)
# ---------- end reptile ----------
